# Grasshopper definition path_hops.gh (Grasshopper 1.0.8)
# plug-ins: treesloth01, Pufferfish, ShapeDiverForGrasshopper

sddp = ShapeDiverDocumentPayload({AbsoluteTolerance=0, AngleTolerance=0, DistanceDisplayPrecision=0, GltfVersion="Gltf2", GrasshopperVersion="1.0.0008", InputGroups="{}", OutputGroups="{}", RelativeTolerance=0, RhinoVersion="8.14.24345.15001", UnitSystem=0, VersionCreated="1.22.0.0", VersionSaved="1.22.0.0"})
angle_start = Slider(0, range=0..12)
angle = Slider(5, range=0..12)
height_start = Slider(0, range=0..12)
height = Slider(0.05, range=0..0.1)
radius_outer = Slider(150, range=0..1000)
radius_inner = Slider(70, range=0..100)
angle_2 = GetNumber(angle, AtLeast=1, AtMost=1, Maximum=1.797693135e+308, Minimum=-1.797693135e+308, TreeAccess=False)
height_2 = GetNumber(height, AtLeast=1, AtMost=1, Maximum=1.797693135e+308, Minimum=-1.797693135e+308, TreeAccess=False)
pi = Pi(Factor=angle_start)
pi_2 = Pi(Factor=angle_2)
pi_3 = Pi(Factor=height_start)
pi_4 = Pi(Factor=height_2)
innerradius = GetNumber(radius_inner, AtLeast=1, AtMost=1, Maximum=1.797693135e+308, Minimum=-1.797693135e+308, TreeAccess=False)
outerradius = GetNumber(radius_outer, AtLeast=1, AtMost=1, Maximum=1.797693135e+308, Minimum=-1.797693135e+308, TreeAccess=False)
count = Slider(100, range=0..100)
construct_domain = ConstructDomain(DomainStart=pi, DomainEnd=pi_2)
construct_domain_2 = ConstructDomain(DomainStart=pi_3, DomainEnd=pi_4)
construct_domain_3 = ConstructDomain(DomainStart=innerradius, DomainEnd=outerradius)
range = Range(Domain=construct_domain, Steps=count)
range_2 = Range(Domain=construct_domain_2, Steps=count)
range_3 = Range(Domain=construct_domain_3, Steps=count)
point_polar = PointPolar(BasePlane=PlaneXY(0, 0, 0), XYAngle=range, ZAngle=range_2, Offset=range_3)
unit_z = UnitZ(Factor=1)
panel = Panel("""0
-1""")
negative = Negative(Value=unit_z)
list_item = ListItem(List=point_polar, Index=panel, Wrap=True)
merge = Merge(Data1=unit_z, Data2=negative)  # -> reverse(Result)
line_sdl = LineSDL(Start=list_item, Direction=merge, Length=Slider(150, range=0..1000))
blend_factor = Slider(50, range=0..1000)
interpolate = Interpolate(Vertices=point_polar, Degree=3, Periodic=False, KnotStyle=1)  # -> Curve, Length, Domain
blend_factor_2 = GetNumber(blend_factor, AtLeast=1, AtMost=1, Maximum=1.797693135e+308, Minimum=-1.797693135e+308, TreeAccess=False)
negative_2 = Negative(Value=blend_factor_2)
negative_3 = Negative(Value=blend_factor_2)
extend_curve = ExtendCurve(Curve=line_sdl, Type=0, Start=negative_2, End="0")
extend_curve_2 = ExtendCurve(Curve=interpolate.Curve, Type=0, Start=negative_3, End=negative_3)
flip_curve = FlipCurve(Curve=extend_curve_2)  # -> Curve, Flag
number_slider = Slider(0.4, range=0..1)
flip_curve_2 = FlipCurve(Curve=extend_curve)  # -> Curve, Flag
merge_2 = Merge(Data1=extend_curve_2, Data2=flip_curve.Curve)
blend_curve = BlendCurve(CurveA=flip_curve_2.Curve, CurveB=merge_2, BulgeA=number_slider, BulgeB=number_slider, Continuity=2)
join_curves = JoinCurves(Curves=[extend_curve_2, flip_curve_2.Curve, blend_curve], Preserve=False)
sweep_division_count = Slider(100, range=0..100)
sweep_thickness = Slider(12, range=0..100)

length = Length(Curve=join_curves)
text = Text(length)

thickness = GetNumber(sweep_thickness, AtLeast=1, AtMost=1, Maximum=1.797693135e+308, Minimum=-1.797693135e+308, TreeAccess=False)
negative_4 = Negative(Value=sweep_thickness)
count_2 = GetInteger(sweep_division_count, AtLeast=1, AtMost=1, Maximum=2147483647, Minimum=-2147483648, TreeAccess=False)
construct_domain_4 = ConstructDomain(DomainStart=thickness, DomainEnd=negative_4)
perp_frames = PerpFrames(Curve=join_curves, Count=count_2, Align=True)  # -> Frames, Parameters
number_slider_2 = Slider(1.08, range=0..10)
rotate_plane = RotatePlane(Plane=perp_frames.Frames, Angle=expr("-x", degrees(Slider(25, range=0..100))))
negative_5 = Negative(Value=number_slider_2)
rectangle = Rectangle(Plane=rotate_plane, XSize=construct_domain_4, YSize=construct_domain_4, Radius=0)  # -> Rectangle, Length
rectangle_2 = Rectangle(Plane=rotate_plane, XSize=construct_domain_4, YSize=construct_domain_4, Radius=0)  # -> graft(Rectangle), Length
merge_3 = Merge(Data1=number_slider_2, Data2=negative_5)
number_slider_3 = Slider(0.98, range=0..1)
offset_curve = OffsetCurve(Curve=rectangle_2.Rectangle, Distance=merge_3, Corners=1)
loft = Loft(
    Curves=rectangle.Rectangle,
    Options={Adjust=False, Closed=False, LoftEnds=0, LoftSimp=0, LoftType=0, Rebuild=10, Refit=0.01})
expression = Expression(x=number_slider_3, Expression="1-x")
cap_holes = CapHoles(Brep=loft)
explode = Explode(Curve=offset_curve, Recursive=True)  # -> Segments, Vertices
context_bake = ContextBake(Content=cap_holes)
merge_4 = Merge(Data1=number_slider_3, Data2=expression)
shatter = Shatter(Curve=reparameterize(explode.Segments), Parameters=merge_4)  # -> simplify(Segments)
evaluate_curve = EvaluateCurve(Curve=reparameterize(explode.Segments), Parameter=merge_4)  # -> Point, Tangent, Angle
trim_tree = TrimTree(Tree=shatter, Depth=1)
param_viewer = ParamViewer(shatter)
flip_last = FlipLast(Data=trim_tree)
param_viewer_2 = ParamViewer(trim_tree)
param_viewer_3 = ParamViewer(flip_last)
loft_2 = Loft(Curves=flip_last, Options={Adjust=False, Closed=False, LoftEnds=0, LoftSimp=0, LoftType=0, Rebuild=10, Refit=0.01})
flip_last_2 = FlipLast(Data=loft_2)
panel_2 = Panel("""1
4
7
10""")
cull_index = CullIndex(List=flip_last_2, Indices=panel_2, Wrap=True)
list_item_2 = ListItem(List=flip_last_2, Index=panel_2, Wrap=True)
brep_join = BrepJoin(Breps=[cull_index, list_item_2])  # -> simplify(Breps), Closed
trim_tree_2 = TrimTree(Tree=brep_join.Breps, Depth=1)
flip_matrix = FlipMatrix(Data=trim_tree_2)
curve = Curve(flip_matrix)
loft_3 = Loft(Curves=curve, Options={Adjust=False, Closed=False, LoftEnds=0, LoftSimp=0, LoftType=0, Rebuild=10, Refit=0.01})
offset_surface = OffsetSurface(Surface=list_item_2, Distance=Slider(0.5, range=0..1), BothSides=False, CreateSolid=True)
cap_holes_2 = CapHoles(Brep=loft_3)
merge_5 = Merge(Data1=cap_holes_2, Data2=offset_surface)  # -> flatten(Result)
custom_preview = CustomPreview(Geometry=merge_5, Material=ColourSwatch(SwatchColor=RGB(102, 70, 70)))
