# Grasshopper definition path_hops_test.gh (Grasshopper 1.0.8)
# plug-ins: Hops

panel = Panel("https://github.com/sedasoylu/bimsc25-datamgmt-session01/raw/refs/heads/main/path_hops_v02.gh")
hops = Hops(
    Angle=5,
    Height=0.05,
    InnerRadius=70,
    OuterRadius=150,
    Blend_factor=50,
    Count=100,
    Thickness=12,
    CacheResultsInMemory=True,
    CacheSolveResults=True,
    RemoteDefinitionLocation="C:\Users\nseda\Documents\GitHub\BIMSC25-datamgmt-session01\bimsc25-datamgmt-session01\path_hops_v02.gh",
    RemoteSolveVersion=(0, 1, 0),
    ShowInput_Enabled=False,
    ShowInput_Path=False,
    SynchronousSolve=True)
hops_2 = Hops(
    _Path=panel,
    Angle=Slider(5, range=0..10),
    Height=Slider(0.05, range=0..0.1),
    InnerRadius=Slider(20, range=0..100),
    OuterRadius=Slider(100, range=0..100),
    Blend_factor=Slider(50, range=0..100),
    Count=Slider(100, range=0..100),
    Thickness=Slider(12, range=0..100),
    CacheResultsInMemory=True,
    CacheSolveResults=True,
    RemoteDefinitionLocation="https://github.com/sedasoylu/bimsc25-datamgmt-session01/raw/refs/heads/main/path_hops_v02.gh",
    RemoteSolveVersion=(0, 1, 0),
    ShowInput_Enabled=False,
    ShowInput_Path=True,
    SynchronousSolve=True)
