# Grasshopper definition path_hops_v02.gh (Grasshopper 1.0.8)
# plug-ins: ShapeDiverForGrasshopper

sddp = ShapeDiverDocumentPayload({AbsoluteTolerance=0, AngleTolerance=0, DistanceDisplayPrecision=0, GltfVersion="Gltf2", GrasshopperVersion="1.0.0008", InputGroups="{}", OutputGroups="{}", RelativeTolerance=0, RhinoVersion="8.14.24345.15001", UnitSystem=0, VersionCreated="1.22.0.0", VersionSaved="1.22.0.0"})
angle_start = Slider(0, range=0..12)
angle = Slider(5, range=0..12)
height_start = Slider(0, range=0..12)
height = Slider(0.05, range=0..0.1)
radius_outer = Slider(150, range=0..1000)
radius_inner = Slider(70, range=0..100)
angle_2 = GetNumber(angle, AtLeast=1, AtMost=1, Maximum=1.797693135e+308, Minimum=-1.797693135e+308, TreeAccess=False)
height_2 = GetNumber(height, AtLeast=1, AtMost=1, Maximum=1.797693135e+308, Minimum=-1.797693135e+308, TreeAccess=False)
find_assemblies = GhPythonScript()  # -> out
# ---------- find_assemblies: Python ----------
import Grasshopper as gh

this = ghenv.Component
thisDoc = this.OnPingDocument()

asms = []

for obj in thisDoc.Objects:
    #print obj.GetType().BaseType
    
    #if obj.Obsolete: print 'Warning: Obsolete'
    #print 'Name: {}\nDescription: {}\nCategory: {} -> {}\n '.format(obj.Name, obj.Description, obj.Category, obj.SubCategory)
    #print 'Pivot: {} \t Bounds: {}'.format(obj.Attributes.Pivot, obj.Attributes.Bounds)
    
    asm = gh.Instances.ComponentServer.FindAssemblyByObject(obj.ComponentGuid)
    
    #print(x.IsCoreLibrary)
    if asm is not None and not asm.IsCoreLibrary:
        asms.append(asm.Name)
    
print asms
# ---------- end find_assemblies ----------
pi = Pi(Factor=angle_start)
pi_2 = Pi(Factor=angle_2)
pi_3 = Pi(Factor=height_start)
pi_4 = Pi(Factor=height_2)
innerradius = GetNumber(radius_inner, AtLeast=1, AtMost=1, Maximum=1.797693135e+308, Minimum=-1.797693135e+308, TreeAccess=False)
outerradius = GetNumber(radius_outer, AtLeast=1, AtMost=1, Maximum=1.797693135e+308, Minimum=-1.797693135e+308, TreeAccess=False)
count = Slider(100, range=0..100)
construct_domain = ConstructDomain(DomainStart=pi, DomainEnd=pi_2)
construct_domain_2 = ConstructDomain(DomainStart=pi_3, DomainEnd=pi_4)
construct_domain_3 = ConstructDomain(DomainStart=innerradius, DomainEnd=outerradius)
panel = Panel(find_assemblies)
range = Range(Domain=construct_domain, Steps=count)
range_2 = Range(Domain=construct_domain_2, Steps=count)
range_3 = Range(Domain=construct_domain_3, Steps=count)
point_polar = PointPolar(BasePlane=PlaneXY(0, 0, 0), XYAngle=range, ZAngle=range_2, Offset=range_3)
unit_z = UnitZ(Factor=1)
panel_2 = Panel("""0
-1""")
negative = Negative(Value=unit_z)
list_item = ListItem(List=point_polar, Index=panel_2, Wrap=True)
merge = Merge(Data1=unit_z, Data2=negative)  # -> reverse(Result)
line_sdl = LineSDL(Start=list_item, Direction=merge, Length=Slider(150, range=0..1000))
blend_factor = Slider(50, range=0..1000)
interpolate = Interpolate(Vertices=point_polar, Degree=3, Periodic=False, KnotStyle=1)  # -> Curve, Length, Domain
blend_factor_2 = GetNumber(blend_factor, AtLeast=1, AtMost=1, Maximum=1.797693135e+308, Minimum=-1.797693135e+308, TreeAccess=False)
negative_2 = Negative(Value=blend_factor_2)
negative_3 = Negative(Value=blend_factor_2)
extend_curve = ExtendCurve(Curve=line_sdl, Type=0, Start=negative_2, End="0")
extend_curve_2 = ExtendCurve(Curve=interpolate.Curve, Type=0, Start=negative_3, End=negative_3)
flip_curve = FlipCurve(Curve=extend_curve_2)  # -> Curve, Flag
number_slider = Slider(0.4, range=0..1)
flip_curve_2 = FlipCurve(Curve=extend_curve)  # -> Curve, Flag
merge_2 = Merge(Data1=extend_curve_2, Data2=flip_curve.Curve)
blend_curve = BlendCurve(CurveA=flip_curve_2.Curve, CurveB=merge_2, BulgeA=number_slider, BulgeB=number_slider, Continuity=2)
join_curves = JoinCurves(Curves=[extend_curve_2, flip_curve_2.Curve, blend_curve], Preserve=False)
sweep_division_count = Slider(100, range=0..100)
sweep_thickness = Slider(12, range=0..100)
thickness = GetNumber(sweep_thickness, AtLeast=1, AtMost=1, Maximum=1.797693135e+308, Minimum=-1.797693135e+308, TreeAccess=False)
negative_4 = Negative(Value=sweep_thickness)
count_2 = GetInteger(sweep_division_count, AtLeast=1, AtMost=1, Maximum=2147483647, Minimum=-2147483648, TreeAccess=False)
construct_domain_4 = ConstructDomain(DomainStart=thickness, DomainEnd=negative_4)
perp_frames = PerpFrames(Curve=join_curves, Count=count_2, Align=True)  # -> Frames, Parameters
rotate_plane = RotatePlane(Plane=perp_frames.Frames, Angle=expr("-x", degrees(Slider(25, range=0..100))))
rectangle = Rectangle(Plane=rotate_plane, XSize=construct_domain_4, YSize=construct_domain_4, Radius=0)  # -> Rectangle, Length
loft = Loft(
    Curves=rectangle.Rectangle,
    Options={Adjust=False, Closed=False, LoftEnds=0, LoftSimp=0, LoftType=0, Rebuild=10, Refit=0.01})
cap_holes = CapHoles(Brep=loft)
context_bake = ContextBake(Content=cap_holes)
