# Grasshopper definition test.gh (Grasshopper 1.0.8)

get_number = GetNumber(Slider(10, range=0..10), AtLeast=1, AtMost=1, Maximum=1.797693135e+308, Minimum=-1.797693135e+308, TreeAccess=False)
get_number_2 = GetNumber(Slider(10, range=0..10), AtLeast=1, AtMost=1, Maximum=1.797693135e+308, Minimum=-1.797693135e+308, TreeAccess=False)
circle = Circle(Plane=PlaneXY(0, 0, 0), Radius=get_number)
unit_z = UnitZ(Factor=get_number_2)
extrude = Extrude(Base=circle, Direction=unit_z)
context_bake = ContextBake(Content=extrude)
